# Grasshopper definition exampleDefinition.gh (Grasshopper 0.9.76)
# plug-ins: Tortuga

# ----
# Geometry
polygon = Polygon(Plane=PlaneXY(0, 0, 0), Radius=3, Segments=6, FilletRadius=0)  # -> Polygon, Length
boundary = BoundarySurfaces(Edges=polygon.Polygon)
pcen = PolygonCenter(Polyline=polygon.Polygon)  # -> CenterV, CenterE, CenterA
Z = UnitZ(Factor=1)
move = Move(Geometry=pcen.CenterV, Motion=Vector(0, 0, 10))  # -> Geometry, Transform
extr = Extrude(Base=boundary, Direction=Z)

# ----
# Material
panel = Panel("exampleData.csv")
material_editor = TortugaMaterialEditor(assembly="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")
multiplication = TortugaMaterialMultiplication(Material=material_editor, Factor=Slider(1, range=0..1))

pt = Point(move.Geometry)
brep = Brep(extr)
srf = Surface(boundary)

# ----
# Calculation
number_slider = Slider(1, range=0..1)
number_slider_2 = Slider(4, range=0..10)
calculator = TortugaVolumeCalculator(Material=multiplication, Brep=brep)
calculator_2 = TortugaFoundationCalculator(
    Material=multiplication,
    Point=pt,
    Piles=Slider(3, range=0..10),
    PileRadius=Slider(0.4, range=0..1),
    PileLength=number_slider_2,
    PlateThickness=number_slider,
    PlateLength=number_slider_2,
    PlateWidth=number_slider_2)
calculator_3 = TortugaCalculator(Material=multiplication, Surface=srf)

# ----
# Result
calculator_result = TortugaCalculatorResult(LCAResult=[calculator_3, calculator, calculator_2])  # -> GlobalWarmingPotential, Acidification, DepletionOfNonrenewbles, DepletionOfOzoneLayer, Eutrophication, FormationTroposphericOzone
panel_2 = Panel([calculator_result.GlobalWarmingPotential, calculator_result.Acidification, calculator_result.DepletionOfNonrenewbles, calculator_result.DepletionOfOzoneLayer, calculator_result.Eutrophication, calculator_result.FormationTroposphericOzone])
